# Dynamo graph Renombrar parámetro de familia.dyn (Dynamo 2.3.0.5885)

code_block = CodeBlock()
# ---------- code_block.designscript (21 lines) ----------
"Casework";
"Ceilings";
"Columns";
"Curtain Panels";
"Curtain Wall Mullions";
"Detail Items";
"Doors";
"Floors";
"Furniture";
"Generic Models";
"Planting";
"Plumbing Fixtures";
"Railings";
"Ramps";
"Site";
"Specialty Equipment";
"Stairs";
"Structural Columns";
"Structural Framing";
"Walls";
"Windows";
# ----------------------------------------
list_create = List.Create(item0=code_block.out0, item1=code_block.out1, item2=code_block.out2, item3=code_block.out3, item4=code_block.out4, item5=code_block.out5, item6=code_block.out6, item7=code_block.out7, item8=code_block.out8, item9=code_block.out9, item10=code_block.out10, item11=code_block.out11, item12=code_block.out12, item13=code_block.out13, item14=code_block.out14, item15=code_block.out15, item16=code_block.out16, item17=code_block.out17, item18=code_block.out18, item19=code_block.out19, item20=code_block.out20)
byName = Category.ByName(name=list_create)
all_elements_of_category = ElementsOfCategory(Category=byName)
elementType = Element.ElementType(element=all_elements_of_category)
string = StringInput("Keynote")
getParameterValueByName = Element.GetParameterValueByName(element=elementType, parameterName=string)
string_from_object = FromObject(obj=getParameterValueByName)
length = String.Length(str=string_from_object)
code_block_2 = CodeBlock { 0; }
ne = length != code_block_2
filterByBoolMask = List.FilterByBoolMask(list=elementType, mask=ne)
code_block_3 = CodeBlock { "ARQ1-"; "ARQ1-"; ""; }
filterByBoolMask_2 = List.FilterByBoolMask(list=string_from_object, mask=ne)
string_from_object_2 = FromObject(obj=filterByBoolMask_2.in)
replace = String.Replace(str=string_from_object_2, searchFor=code_block_3.out1, replaceWith=code_block_3.out2)
add = code_block_3.out0 + replace
setParameterByName = Element.SetParameterByName(element=filterByBoolMask.in, parameterName=string, value=add)
code_block_4 = CodeBlock()
# ---------- code_block_4.designscript (6 lines) ----------
Nota:

El script se debe ejecutar en modo manual (no automática)

Se debe agregar las categorías que qplique a
la prmera lista (List Create);
# ----------------------------------------
watch = Watch(string_from_object)
watch_2 = Watch(string_from_object_2)
getMaterials = Element.GetMaterials()  # unwired: element
code_block_5 = CodeBlock { ""; }
watch_3 = Watch(replace)
watch_4 = Watch(add)
watch_5 = Watch(filterByBoolMask_2.in)
watch_6 = Watch(ne)
code_block_6 = CodeBlock { ""; }
categories = Categories("OST_Materials")
all_elements_of_category_2 = ElementsOfCategory(Category=categories)
getParameterValueByName_2 = Element.GetParameterValueByName(element=all_elements_of_category_2, parameterName=string)
string_from_object_3 = FromObject(obj=getParameterValueByName_2)
length_2 = String.Length(str=string_from_object_3)
code_block_7 = CodeBlock { 0; }
ne_2 = length_2 != code_block_7
filterByBoolMask_3 = List.FilterByBoolMask(list=all_elements_of_category_2, mask=ne_2)
code_block_8 = CodeBlock { "ARQ1-"; "ARQ1-"; ""; }
filterByBoolMask_4 = List.FilterByBoolMask(list=string_from_object_3, mask=ne_2)
string_from_object_4 = FromObject(obj=filterByBoolMask_4.in)
replace_2 = String.Replace(str=string_from_object_4, searchFor=code_block_8.out1, replaceWith=code_block_8.out2)
add_2 = code_block_8.out0 + replace_2
setParameterByName_2 = Element.SetParameterByName(element=filterByBoolMask_3.in, parameterName=string, value=add_2)
watch_7 = Watch(add_2)
watch_8 = Watch(replace_2)
watch_9 = Watch(string_from_object_4)
watch_10 = Watch(filterByBoolMask_4.in)
watch_11 = Watch(ne_2)
watch_12 = Watch(string_from_object_3)
